# Grasshopper definition BeamCode_Twister.gh (Grasshopper 0.9.76)
# plug-ins: Kangaroo2 Components

C = Curve([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])
divlength = DivideLength(Curve=C, Length=2.5)  # -> Points, Tangents, Parameters
rectangle = Rectangle(Plane=PlaneXY(0, 0, 0), XSize="0.1", YSize="0.1", Radius=0)  # -> Rectangle, Length
pline = PolyLine(Vertices=divlength.Points, Closed=False)
explode = Explode(Curve=pline, Recursive=True)  # -> Segments, Vertices
pt = Point(Point(30, 5, 0))
pt_2 = Point(Point(5, 5, 0))
k2_areamoments = CSharpScript(SectionCrv=rectangle.Rectangle)  # -> out, A, Ix, Iy, J; inputs SectionCrv: Curve
# ---------- k2_areamoments: C# ----------
    AreaMassProperties AMP = AreaMassProperties.Compute(SectionCrv);

    A = AMP.Area;

    Rhino.Geometry.Vector3d MI = AMP.CentroidCoordinatesMomentsOfInertia;

    Ix = MI.X;
    Iy = MI.Y;
    J = MI.Z;
# ---------- end k2_areamoments ----------
pframe = PerpFrame(Curve=reparameterize(explode.Segments), Parameter=1)
pframe_2 = PerpFrame(Curve=reparameterize(explode.Segments), Parameter=0)
xy = XYPlane(Origin=pt)
xy_2 = XYPlane(Origin=pt_2)
k2_beam_goal = CSharpScript(
    StartFrame=pframe_2,
    EndFrame=pframe,
    E="210000000000",
    A=k2_areamoments.A,
    Ix=k2_areamoments.Ix,
    Iy=k2_areamoments.Iy,
    J=k2_areamoments.J,
    G="70000000000",
    Reference="C:\Users\DSegraves\AppData\Roaming\Grasshopper\Libraries\Other\Kangaroo\KangarooSolver.dll")  # -> out, B; inputs StartFrame: Plane, EndFrame: Plane, E: Double, A: Double, Ix: Double, Iy: Double, J: Double, G: Double
# ---------- k2_beam_goal: C# ----------
    double L = StartFrame.Origin.DistanceTo(EndFrame.Origin);

    Plane NodeA;
    NodeA = new Plane(StartFrame.Origin, Vector3d.XAxis, Vector3d.YAxis);

    Plane NodeB;
    NodeB = new Plane(EndFrame.Origin, Vector3d.XAxis, Vector3d.YAxis);

    B = new Beam(StartFrame, EndFrame, NodeA, NodeB, L, E, A, Ix, Iy, G, J);
# ---------- k2_beam_goal: C# additional code ----------
  public class Beam : GoalObject
  {

    public Plane P0; //Original plane at first node
    public Plane P1; //Original plane at second node
    public Plane P0R; //Current plane at first node
    public Plane P1R; //Current plane at second node

    public double E; //YoungsModulus;
    public double Ix; //SecondMomentOfAreaAroundXX
    public double Iy; //SecondMomentOfAreaAroundYY
    public double G; // ShearModulus;
    public double J; // MomentOfInertiaInTorsion

    private Vector3d F1, F2, M1, M2;


    public double A, GJ, L0;
    public double TX1, TX2, TY1, TY2, twist;

    public Beam(Plane StartPlane, Plane EndPlane, Plane StartNode, Plane EndNode, double L,
      double E, double A, double Ix, double Iy, double G, double J)

    {
      this.P0 = StartPlane;
      this.P1 = EndPlane;

      this.P0.Transform(Transform.ChangeBasis(Plane.WorldXY, StartNode));
      this.P1.Transform(Transform.ChangeBasis(Plane.WorldXY, EndNode));

      L0 = L;
      this.E = E;
      this.A = A;
      this.Ix = Ix;
      this.Iy = Iy;
      this.GJ = G * J;


      PPos = new Point3d[2] {StartPlane.Origin, EndPlane.Origin};
      Move = new Vector3d[2];
      Weighting = new double[2] {1, 1};
      Torque = new Vector3d[2];
      TorqueWeighting = new double[2] {1, 1};

      InitialOrientation = new Plane[2] {StartNode, EndNode};

      P0R = StartPlane;
      P1R = EndPlane;
    }


    public double CalculateTheta(Vector3d p, Vector3d x)
    {
      p.Unitize();
      return p * x;
    }

    public double CalculateTwist(Vector3d x1, Vector3d x2, Vector3d y1, Vector3d y2)
    {
      return (x1 * y2 - x2 * y1) * 0.5;
    }

    public double CalculateElongation(Vector3d p, double L0, double Tx1, double Tx2, double Ty1, double Ty2)
    {
      return (p * p - L0 * L0) / (2 * L0) + L0 / 60 * (4 * (Tx1 * Tx1 + Ty1 * Ty1) - 2 * (Tx1 * Tx2 - Ty1 * Ty2) + 4 * (Tx2 * Tx2 + Ty2 * Ty2));
    }

    public double CalculateN(double E, double A, double L0, double e)
    {
      return E * A / L0 * e;
    }

    public double CalculateM(double N, double L0, double Tx1, double Tx2)
    {
      return N * L0 / 30 * (4 * Tx1 - Tx2) + 2 * E * Ix / L0 * (2 * Tx1 + Tx2);
    }

    public double CalculateMT(double G, double J, double L0, double Tz)
    {
      return G * J / Tz * L0;
    }

    public Vector3d CalculateForceAtNode1(double N, Vector3d p, double Mx1, Vector3d y1, double My1, Vector3d x1,
      double Mx2, Vector3d y2, double My2, Vector3d x2, double L0)
    {
      return (N * p + Mx1 * y1 - My1 * x1 + Mx2 * y2 + My2 * x2) / L0;
    }

    private Vector3d CalculateMomentCompA(Vector3d p, double Mx, Vector3d y, double My, Vector3d x, double L0)
    {
      return Mx * Vector3d.CrossProduct(y, p) / L0 - My * Vector3d.CrossProduct(x, p) / L0;
    }

    private Vector3d CalculateMomentCompB(double MT, Vector3d y1, Vector3d x1, Vector3d y2, Vector3d x2)
    {
      return MT * (Vector3d.CrossProduct(x1, y2) - Vector3d.CrossProduct(y1, x2));
    }

    public override void Calculate(List<KangarooSolver.Particle> p)
    {
      //get the current positions/orientations of the nodes
      Plane NodeACurrent = p[PIndex[0]].Orientation;
      Plane NodeBCurrent = p[PIndex[1]].Orientation;

      //get the initial orientations of the beam end frames..
      P0R = P0;
      P1R = P1;
      //..and transform them to get the current beam end frames
      P0R.Transform(Transform.PlaneToPlane(Plane.WorldXY, NodeACurrent));
      P1R.Transform(Transform.PlaneToPlane(Plane.WorldXY, NodeBCurrent));

      //Find local angle changes
      Vector3d x1 = P0R.XAxis;
      Vector3d x2 = P1R.XAxis;
      Vector3d y1 = P0R.YAxis;
      Vector3d y2 = P1R.YAxis;

      Vector3d Current = P1R.Origin - P0R.Origin;
      double Ty1 = CalculateTheta(Current, x1);
      double Tx1 = CalculateTheta(Current, y1);
      double Ty2 = CalculateTheta(Current, x2);
      double Tx2 = CalculateTheta(Current, y2);
      double Tz = CalculateTwist(x1, x2, y1, y2);

      //Determine member forces
      double e = CalculateElongation(Current, L0, Tx1, Tx2, Ty1, Ty2);
      double N = CalculateN(E, A, L0, e);
      double Mx1 = CalculateM(N, L0, Tx1, Tx2);
      double Mx2 = CalculateM(N, L0, Tx2, Tx1);
      double My1 = CalculateM(N, L0, Ty1, Ty2);
      double My2 = CalculateM(N, L0, Ty2, Ty1);
      double Mz = CalculateMT(G, J, L0, Tz);

      //Determine end point forces
      F1 = CalculateForceAtNode1(N, Current, Mx1, y1, My1, x1, Mx2, y2, My2, x2, L0);
      F2 = -1 * F1;

      Vector3d MCompB = CalculateMomentCompB(Mz, y1, x1, y2, x2);
      M1 = -(CalculateMomentCompA(Current, Mx1, y1, My1, x1, L0) + MCompB);
      M2 = -(CalculateMomentCompA(Current, Mx2, y2, My2, x2, L0) + MCompB);

      //Move
      Move[0] = F1;
      Move[1] = F2;
      Torque[0] = M1;
      Torque[1] = M2;
    }
    public override object Output(List<KangarooSolver.Particle> p)
    {
      List<object> DataOut = new List<object>();

      DataOut.Add(F1);
      DataOut.Add(F2);
      DataOut.Add(M1);
      DataOut.Add(M2);

      return DataOut;
    }
  }
# ---------- end k2_beam_goal ----------
beam = Beam(StartFrame=pframe_2, EndFrame=pframe, E=1, A=1, Ix=1, Iy=1, GJ=1)  # disabled
support = Support(
    Frame=xy,
    X=Toggle(True),
    Y=Toggle(True),
    Z=Toggle(True),
    XX=Toggle(True),
    YY=Toggle(True),
    ZZ=Toggle(True),
    Strength=100)
c_script = CSharpScript(
    StartFrame=pframe_2,
    EndFrame=pframe,
    E=1,
    Reference="C:\Users\DSegraves\AppData\Roaming\Grasshopper\Libraries\Other\Kangaroo\KangarooSolver.dll")  # -> out, B; inputs StartFrame: Plane, EndFrame: Plane, StartNode: Plane, EndNode: Plane, E: Double, A: Double, Ix: Double, Iy: Double, GJ: Double
# ---------- c_script: C# ----------
    double L = StartFrame.Origin.DistanceTo(EndFrame.Origin);

    Plane NodeA;
    if(!StartNode.IsValid)
    {
      NodeA = new Plane(StartFrame.Origin, Vector3d.XAxis, Vector3d.YAxis);
    }
    else
    {
      NodeA = StartNode;
    }

    Plane NodeB;
    if(!EndNode.IsValid)
    {
      NodeB = new Plane(EndFrame.Origin, Vector3d.XAxis, Vector3d.YAxis);
    }
    else
    {
      NodeB = EndNode;
    }

    B = new Beam(StartFrame, EndFrame, NodeA, NodeB, L, E, 1, 1, 1, 1);
# ---------- c_script: C# additional code ----------
  public class Beam : GoalObject
  {
    //the initial end frames of the beam relative to their nodes
    public Plane P0;
    public Plane P1;

    public Plane P0R;
    public Plane P1R;

    public double E, A, Ix, Iy, GJ, RestLength;
    public double TX1, TX2, TY1, TY2, twist;

    public Beam(Plane StartPlane, Plane EndPlane, Plane StartNode, Plane EndNode, double L, double E, double A, double Ix, double Iy, double GJ)
    {
      this.P0 = StartPlane;
      this.P1 = EndPlane;

      this.P0.Transform(Transform.ChangeBasis(Plane.WorldXY, StartNode));
      this.P1.Transform(Transform.ChangeBasis(Plane.WorldXY, EndNode));

      RestLength = L;
      this.E = E;
      this.A = A;
      this.Ix = Ix;
      this.Iy = Iy;
      this.GJ = GJ;

      PPos = new Point3d[2] { StartPlane.Origin, EndPlane.Origin };
      Move = new Vector3d[2];
      Weighting = new double[2] { E, E };
      Torque = new Vector3d[2];
      TorqueWeighting = new double[2] { E, E };

      InitialOrientation = new Plane[2] { StartNode, EndNode };

      P0R = StartPlane;
      P1R = EndPlane;
    }

    public override void Calculate(List<KangarooSolver.Particle> p)
    {
      //get the current positions/orientations of the nodes
      Plane NodeACurrent = p[PIndex[0]].Orientation;
      Plane NodeBCurrent = p[PIndex[1]].Orientation;

      //get the initial orientations of the beam end frames..
      P0R = P0;
      P1R = P1;
      //..and transform them to get the current beam end frames
      P0R.Transform(Transform.PlaneToPlane(Plane.WorldXY, NodeACurrent));
      P1R.Transform(Transform.PlaneToPlane(Plane.WorldXY, NodeBCurrent));

      //axial (ignoring elongation due to bowing for now)
      Vector3d Current = P1R.Origin - P0R.Origin;
      double CurrentLength = Current.Length;
      double Stretch = CurrentLength - RestLength;
      Vector3d AxialMove = 0.5 * (Current / CurrentLength) * Stretch;

      Vector3d X1 = P0R.XAxis;
      Vector3d Y1 = P0R.YAxis;
      Vector3d X2 = P1R.XAxis;
      Vector3d Y2 = P1R.YAxis;

      //bend angles
      Vector3d UnitCurrent = Current;
      UnitCurrent.Unitize();
      TX1 = Y1 * UnitCurrent;
      TX2 = Y2 * UnitCurrent;
      TY1 = X1 * UnitCurrent;
      TY2 = X2 * UnitCurrent;

      //twist
      twist = ((X1 * Y2) - (X2 * Y1)) / 2.0;

      //moments
      Vector3d Moment1 = (X1 * TX1) - (Y1 * TY1);
      Vector3d Moment2 = (X2 * TX2) - (Y2 * TY2);

      Torque[0] = -0.25 * (Moment1 + twist * Current);
      Torque[1] = -0.25 * (Moment2 - twist * Current);
      TorqueWeighting[0] = TorqueWeighting[1] = E * A;

      //  shears
      Vector3d SY1 = 0.25 * Vector3d.CrossProduct(TX1 * X1, Current);
      Vector3d SX1 = 0.25 * Vector3d.CrossProduct(TY1 * Y1, Current);
      Vector3d SY2 = 0.25 * Vector3d.CrossProduct(TX2 * X2, Current);
      Vector3d SX2 = 0.25 * Vector3d.CrossProduct(TY2 * Y2, Current);

      Move[0] = AxialMove + SX1 - SY1 + SX2 - SY2;
      Move[1] = -Move[0];
    }

    public override object Output(List<KangarooSolver.Particle> p)
    {
      List<object> DataOut = new List<object>();

      DataOut.Add(P0R);
      DataOut.Add(P1R);
      DataOut.Add(TX1);
      DataOut.Add(TX2);
      DataOut.Add(TY1);
      DataOut.Add(TY2);
      DataOut.Add(twist);

      return DataOut;
    }

  }
# ---------- end c_script ----------
support_2 = Support(
    Frame=xy_2,
    X=Toggle(True),
    Y=Toggle(True),
    Z=Toggle(True),
    XX=Toggle(True),
    YY=Toggle(True),
    ZZ=Toggle(True),
    Strength=100)
grab = Grab(On=True, Strength=1, Range=3)  # -> Grab, Anchors

button = Button()
toggle = BooleanToggle(True)

entwine = Entwine(Branch00=k2_beam_goal.B, Branch01=[grab.Grab, support, support_2], FlattenInputs=True)
solver = Solver(GoalObjects=entwine, Reset=button, Threshold=1e-15, Tolerance=0.01, On=toggle)  # -> I, V, O
bouncysolver = BouncySolver(GoalObjects=entwine, Reset=button, Threshold=1e-15, Tolerance=0.01, Damping=0.99, Iterations=50, On=toggle)  # -> I, V, O; disabled
panel = Panel(solver.O)
unflatten = UnflattenTree(Tree=bouncysolver.O, Guide=entwine)
bang = ExplodeTree(Data=unflatten)  # -> Branch0, Branch1
bang_2 = ExplodeTree(Data=solver.O)  # -> Branch0, Branch1
c_script_2 = CSharpScript(x=graft([bang.Branch0, bang_2.Branch0]))  # -> out, P0, P1, TX1, TX2, TY1, TY2, Twist
# ---------- c_script_2: C# ----------
    List<object> data = x as List<object>;
    P0 = data[0];
    P1 = data[1];
    TX1 = data[2];
    TX2 = data[3];
    TY1 = data[4];
    TY2 = data[5];
    Twist = data[6];
# ---------- end c_script_2 ----------
c_script_3 = CSharpScript(
    P0=c_script_2.P0,
    P1=c_script_2.P1,
    x1=c_script_2.TX1,
    x2=c_script_2.TX2,
    y1=c_script_2.TY1,
    y2=c_script_2.TY2,
    scale=Slider(73.216, range=0..101))  # -> out, MX, MY; inputs x1: Double, x2: Double, y1: Double, y2: Double, scale: Double
# ---------- c_script_3: C# ----------
    Plane PA = (Plane) P0;
    Plane PB = (Plane) P1;

    Mesh M0 = new Mesh();
    Point3d[] Verts = new Point3d[4]{
      PA.Origin,
      PA.PointAt(0, -x1 * scale),
      PB.PointAt(0, x2 * scale),
      PB.Origin};

    M0.Vertices.AddVertices(Verts);
    M0.Faces.AddFace(0, 1, 2, 3);

    Mesh M1 = new Mesh();
    Verts = new Point3d[4]{
      PA.Origin,
      PA.PointAt(-y1 * scale, 0),
      PB.PointAt(y2 * scale, 0),
      PB.Origin};

    M1.Vertices.AddVertices(Verts);
    M1.Faces.AddFace(0, 1, 2, 3);

    MX = M0;
    MY = M1;
# ---------- end c_script_3 ----------
c_script_4 = CSharpScript(P0=c_script_2.P0, P1=c_script_2.P1, x=Slider(0.599, range=0..1), y=Slider(0.262, range=0..1))  # -> out, M; inputs x: Double, y: Double
# ---------- c_script_4: C# ----------
    Plane PA = (Plane) P0;
    Plane PB = (Plane) P1;

    Mesh M1 = new Mesh();

    Point3d[] Verts = new Point3d[8]{
      PA.PointAt(x, y),PA.PointAt(-x, y),PA.PointAt(-x, -y),PA.PointAt(x, -y),
      PB.PointAt(x, y),PB.PointAt(-x, y),PB.PointAt(-x, -y),PB.PointAt(x, -y)};
    M1.Vertices.AddVertices(Verts);

    M1.Faces.AddFace(1, 5, 4, 0);
    M1.Faces.AddFace(2, 6, 5, 1);
    M1.Faces.AddFace(3, 7, 6, 2);
    M1.Faces.AddFace(0, 4, 7, 3);

    M = M1;
# ---------- end c_script_4 ----------
c_script_5 = CSharpScript(P0=c_script_2.P0, P1=c_script_2.P1, Twist=c_script_2.Twist, scale=Slider(136.771, range=0..500))  # -> out, T; inputs Twist: Double, scale: Double
# ---------- c_script_5: C# ----------
    Plane PA = (Plane) P0;
    Plane PB = (Plane) P1;

    Vector3d axis = PB.Origin - PA.Origin;
    int sense = 1;
    if(Twist > 0)
    {
      axis.Reverse();
      PA = PB;
      sense = -1;
    }
    T = Rhino.Geometry.NurbsCurve.CreateSpiral(PA.Origin, axis, PA.PointAt(0, sense), axis.Length, sense, scale * Twist, scale * Twist);
# ---------- end c_script_5 ----------
preview = CustomPreview(
    Geometry=c_script_4.M,
    Shader={ambient=RGB(128, 128, 128), diffuse=RGB(0, 128, 128), emission=RGB(0, 0, 0), shine=0, specular=RGB(255, 255, 255), transparency=0})
preview_2 = CustomPreview(
    Geometry=c_script_3.MX,
    Shader={ambient=RGB(128, 128, 128), diffuse=RGB(255, 0, 0), emission=RGB(255, 0, 0), shine=0, specular=RGB(255, 255, 255), transparency=0})
preview_3 = CustomPreview(
    Geometry=c_script_3.MY,
    Shader={ambient=RGB(128, 128, 128), diffuse=RGB(0, 0, 255), emission=RGB(0, 0, 255), shine=0, specular=RGB(255, 255, 255), transparency=0})
preview_4 = CustomPreview(
    Geometry=c_script_5.T,
    Shader={ambient=RGB(128, 128, 128), diffuse=RGB(0, 255, 0), emission=RGB(0, 255, 0), shine=0, specular=RGB(255, 255, 255), transparency=0})
