# Grasshopper definition frame_004.gh (Grasshopper 0.9.76)
# plug-ins: K2Engineering, Kangaroo2 Components

Z = UnitZ(Factor=1)
cluster = Cluster_6()  # -> beam_brep, beam_span, beam_elem_line, beam_sect_crv, plane_00, plane_01, pts_000, pts_001, pts_fixed_2
C = Curve([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])
cluster_2 = Cluster_2()  # -> beam_elem_2, beam_sect_crv, plane_00, plane_01, brep_frame_2, pts_000, pts_001, pts_fixed_2; disabled
amp = Amplitude(Vector=Z, Amplitude=Slider(1, range=0..1000))
divlength = DivideLength(Curve=C, Length=2.5)  # -> Points, Tangents, Parameters
pline = PolyLine(Vertices=divlength.Points, Closed=False)
line = Line(simplify(graft(cluster.beam_elem_line)))
load = Load(Point=cluster.pts_000, NodalForce=amp)
explode = Explode(Curve=pline, Recursive=True)  # -> Segments, Vertices
pt = Point(cluster.pts_fixed_2)
divlength_2 = DivideLength(Curve=line, Length=12)  # -> simplify(Points), Tangents, Parameters
end = EndPoints(Curve=line)  # -> Start, End
pframe = PerpFrame(Curve=reparameterize(explode.Segments), Parameter=1)
pframe_2 = PerpFrame(Curve=reparameterize(explode.Segments), Parameter=0)
xy = XYPlane(Origin=pt)
merge = Merge(Data1=divlength_2.Points, Data2=end.End)
pline_2 = PolyLine(Vertices=merge, Closed=False)
support = Support(
    Frame=xy,
    X=Toggle(True),
    Y=Toggle(True),
    Z=Toggle(True),
    XX=Toggle(True),
    YY=Toggle(True),
    ZZ=Toggle(True),
    Strength=100)
grab = Grab(On=True, Strength=1, Range=3)  # -> Grab, Anchors
explode_2 = Explode(Curve=pline_2, Recursive=True)  # -> Segments, Vertices
pframe_3 = PerpFrame(Curve=reparameterize(explode_2.Segments), Parameter=0)
pframe_4 = PerpFrame(Curve=reparameterize(explode_2.Segments), Parameter=1)
c_script = CSharpScript(
    StartFrame=pframe_3,
    EndFrame=pframe_4,
    E=1,
    Reference="C:\USERS\JWARTON\APPDATA\ROAMING\GRASSHOPPER\LIBRARIES\KangarooSolver.dll")  # -> out, B; inputs StartFrame: Plane, EndFrame: Plane, StartNode: Plane, EndNode: Plane, E: Double, A: Double, Ix: Double, Iy: Double, GJ: Double
# ---------- c_script: C# ----------
    double L = StartFrame.Origin.DistanceTo(EndFrame.Origin);

    Plane NodeA;
    if(!StartNode.IsValid)
    {
      NodeA = new Plane(StartFrame.Origin, Vector3d.XAxis, Vector3d.YAxis);
    }
    else
    {
      NodeA = StartNode;
    }

    Plane NodeB;
    if(!EndNode.IsValid)
    {
      NodeB = new Plane(EndFrame.Origin, Vector3d.XAxis, Vector3d.YAxis);
    }
    else
    {
      NodeB = EndNode;
    }

    B = new Beam(StartFrame, EndFrame, NodeA, NodeB, L, E, 1, 1, 1, 1);
# ---------- c_script: C# additional code ----------
  public class Beam : GoalObject
  {
    //the initial end frames of the beam relative to their nodes
    public Plane P0;
    public Plane P1;

    public Plane P0R;
    public Plane P1R;

    public double E, A, Ix, Iy, GJ, RestLength;
    public double TX1, TX2, TY1, TY2, twist;

    public Beam(Plane StartPlane, Plane EndPlane, Plane StartNode, Plane EndNode, double L, double E, double A, double Ix, double Iy, double GJ)
    {
      this.P0 = StartPlane;
      this.P1 = EndPlane;

      this.P0.Transform(Transform.ChangeBasis(Plane.WorldXY, StartNode));
      this.P1.Transform(Transform.ChangeBasis(Plane.WorldXY, EndNode));

      RestLength = L;
      this.E = E;
      this.A = A;
      this.Ix = Ix;
      this.Iy = Iy;
      this.GJ = GJ;

      PPos = new Point3d[2] { StartPlane.Origin, EndPlane.Origin };
      Move = new Vector3d[2];
      Weighting = new double[2] { E, E };
      Torque = new Vector3d[2];
      TorqueWeighting = new double[2] { E, E };

      InitialOrientation = new Plane[2] { StartNode, EndNode };

      P0R = StartPlane;
      P1R = EndPlane;
    }

    public override void Calculate(List<KangarooSolver.Particle> p)
    {
      //get the current positions/orientations of the nodes
      Plane NodeACurrent = p[PIndex[0]].Orientation;
      Plane NodeBCurrent = p[PIndex[1]].Orientation;

      //get the initial orientations of the beam end frames..
      P0R = P0;
      P1R = P1;
      //..and transform them to get the current beam end frames
      P0R.Transform(Transform.PlaneToPlane(Plane.WorldXY, NodeACurrent));
      P1R.Transform(Transform.PlaneToPlane(Plane.WorldXY, NodeBCurrent));

      //axial (ignoring elongation due to bowing for now)
      Vector3d Current = P1R.Origin - P0R.Origin;
      double CurrentLength = Current.Length;
      double Stretch = CurrentLength - RestLength;
      Vector3d AxialMove = 0.5 * (Current / CurrentLength) * Stretch;

      Vector3d X1 = P0R.XAxis;
      Vector3d Y1 = P0R.YAxis;
      Vector3d X2 = P1R.XAxis;
      Vector3d Y2 = P1R.YAxis;

      //bend angles
      Vector3d UnitCurrent = Current;
      UnitCurrent.Unitize();
      TX1 = Y1 * UnitCurrent;
      TX2 = Y2 * UnitCurrent;
      TY1 = X1 * UnitCurrent;
      TY2 = X2 * UnitCurrent;

      //twist
      twist = ((X1 * Y2) - (X2 * Y1)) / 2.0;

      //moments
      Vector3d Moment1 = (X1 * TX1) - (Y1 * TY1);
      Vector3d Moment2 = (X2 * TX2) - (Y2 * TY2);

      Torque[0] = -0.25 * (Moment1 + twist * Current);
      Torque[1] = -0.25 * (Moment2 - twist * Current);
      TorqueWeighting[0] = TorqueWeighting[1] = E * A;

      //  shears
      Vector3d SY1 = 0.25 * Vector3d.CrossProduct(TX1 * X1, Current);
      Vector3d SX1 = 0.25 * Vector3d.CrossProduct(TY1 * Y1, Current);
      Vector3d SY2 = 0.25 * Vector3d.CrossProduct(TX2 * X2, Current);
      Vector3d SX2 = 0.25 * Vector3d.CrossProduct(TY2 * Y2, Current);

      Move[0] = AxialMove + SX1 - SY1 + SX2 - SY2;
      Move[1] = -Move[0];
    }

    public override object Output(List<KangarooSolver.Particle> p)
    {
      List<object> DataOut = new List<object>();

      DataOut.Add(P0R);
      DataOut.Add(P1R);
      DataOut.Add(TX1);
      DataOut.Add(TX2);
      DataOut.Add(TY1);
      DataOut.Add(TY2);
      DataOut.Add(twist);

      return DataOut;
    }

  }
# ---------- end c_script ----------

button = Button()
toggle = BooleanToggle(False)

entwine = Entwine(Branch00=c_script.B, Branch01=[support, load], FlattenInputs=True)
solver = Solver(GoalObjects=entwine, Reset=button, Threshold=1e-15, Tolerance=0.01, On=toggle)  # -> I, V, O
bouncysolver = BouncySolver(GoalObjects=entwine, Reset=button, Threshold=1e-15, Tolerance=0.01, Damping=0.99, Iterations=50, On=toggle)  # -> I, V, O; disabled
unflatten = UnflattenTree(Tree=bouncysolver.O, Guide=entwine)
bang = ExplodeTree(Data=unflatten)  # -> Branch0, Branch1
bang_2 = ExplodeTree(Data=solver.O)  # -> Branch0, Branch1
c_script_2 = CSharpScript(x=graft([bang.Branch0, bang_2.Branch0]))  # -> out, P0, P1, TX1, TX2, TY1, TY2, Twist
# ---------- c_script_2: C# ----------
    List<object> data = x as List<object>;
    P0 = data[0];
    P1 = data[1];
    TX1 = data[2];
    TX2 = data[3];
    TY1 = data[4];
    TY2 = data[5];
    Twist = data[6];
# ---------- end c_script_2 ----------
panel = Panel(solver.O)
c_script_3 = CSharpScript(
    P0=c_script_2.P0,
    P1=c_script_2.P1,
    x1=c_script_2.TX1,
    x2=c_script_2.TX2,
    y1=c_script_2.TY1,
    y2=c_script_2.TY2,
    scale=Slider(73.216, range=0..101))  # -> out, MX, MY; inputs x1: Double, x2: Double, y1: Double, y2: Double, scale: Double
# ---------- c_script_3: C# ----------
    Plane PA = (Plane) P0;
    Plane PB = (Plane) P1;

    Mesh M0 = new Mesh();
    Point3d[] Verts = new Point3d[4]{
      PA.Origin,
      PA.PointAt(0, -x1 * scale),
      PB.PointAt(0, x2 * scale),
      PB.Origin};

    M0.Vertices.AddVertices(Verts);
    M0.Faces.AddFace(0, 1, 2, 3);

    Mesh M1 = new Mesh();
    Verts = new Point3d[4]{
      PA.Origin,
      PA.PointAt(-y1 * scale, 0),
      PB.PointAt(y2 * scale, 0),
      PB.Origin};

    M1.Vertices.AddVertices(Verts);
    M1.Faces.AddFace(0, 1, 2, 3);

    MX = M0;
    MY = M1;
# ---------- end c_script_3 ----------
c_script_4 = CSharpScript(P0=c_script_2.P0, P1=c_script_2.P1, Twist=c_script_2.Twist, scale=Slider(136.771, range=0..500))  # -> out, T; inputs Twist: Double, scale: Double
# ---------- c_script_4: C# ----------
    Plane PA = (Plane) P0;
    Plane PB = (Plane) P1;

    Vector3d axis = PB.Origin - PA.Origin;
    int sense = 1;
    if(Twist > 0)
    {
      axis.Reverse();
      PA = PB;
      sense = -1;
    }
    T = Rhino.Geometry.NurbsCurve.CreateSpiral(PA.Origin, axis, PA.PointAt(0, sense), axis.Length, sense, scale * Twist, scale * Twist);
# ---------- end c_script_4 ----------
c_script_5 = CSharpScript(P0=c_script_2.P0, P1=c_script_2.P1, x=Slider(0.599, range=0..1), y=Slider(0.262, range=0..1))  # -> out, M; inputs x: Double, y: Double
# ---------- c_script_5: C# ----------
    Plane PA = (Plane) P0;
    Plane PB = (Plane) P1;

    Mesh M1 = new Mesh();

    Point3d[] Verts = new Point3d[8]{
      PA.PointAt(x, y),PA.PointAt(-x, y),PA.PointAt(-x, -y),PA.PointAt(x, -y),
      PB.PointAt(x, y),PB.PointAt(-x, y),PB.PointAt(-x, -y),PB.PointAt(x, -y)};
    M1.Vertices.AddVertices(Verts);

    M1.Faces.AddFace(1, 5, 4, 0);
    M1.Faces.AddFace(2, 6, 5, 1);
    M1.Faces.AddFace(3, 7, 6, 2);
    M1.Faces.AddFace(0, 4, 7, 3);

    M = M1;
# ---------- end c_script_5 ----------
preview = CustomPreview(
    Geometry=c_script_5.M,
    Shader={ambient=RGB(128, 128, 128), diffuse=RGB(0, 128, 128), emission=RGB(0, 0, 0), shine=0, specular=RGB(255, 255, 255), transparency=0})
preview_2 = CustomPreview(
    Geometry=c_script_3.MY,
    Shader={ambient=RGB(128, 128, 128), diffuse=RGB(0, 0, 255), emission=RGB(0, 0, 255), shine=0, specular=RGB(255, 255, 255), transparency=0})
preview_3 = CustomPreview(
    Geometry=c_script_4.T,
    Shader={ambient=RGB(128, 128, 128), diffuse=RGB(0, 255, 0), emission=RGB(0, 255, 0), shine=0, specular=RGB(255, 255, 255), transparency=0})
preview_4 = CustomPreview(
    Geometry=c_script_3.MX,
    Shader={ambient=RGB(128, 128, 128), diffuse=RGB(255, 0, 0), emission=RGB(255, 0, 0), shine=0, specular=RGB(255, 255, 255), transparency=0})

# ==== cluster Cluster_2
multiplication = Multiplication(A=Slider(500, range=0..1000), B=12)
X = UnitX(Factor=1)
amp = Amplitude(Vector=X, Amplitude=multiplication)
crv = Curve(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)
srf = Surface(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)
move = Move(Geometry=crv, Motion=amp)  # -> Geometry, Transform
move_2 = Move(Geometry=srf, Motion=amp)  # -> Geometry, Transform
sdivide = DivideSurface(Surface=reparameterize(move_2.Geometry), UCount=Slider(1, range=0..50), VCount=Slider(5, range=0..50))  # -> Points, Normals, simplify(Parameters)
branch = TreeBranch(Tree=sdivide.Parameters, Path="{1}", MaintainPaths=True)
iso = IsoCurve(Surface=reparameterize(move_2.Geometry), UVPoint=branch)  # -> simplify(UIsocurve), simplify(VIsocurve)
number_slider = Slider(25, range=0..100)
crv_2 = Curve(iso.UIsocurve)
len = Length(Curve=crv_2)  # -> flatten(Length)
bnd = Bounds(Numbers=len)
multiplication_2 = Multiplication(A=Slider(10, range=0..100), B=12)
dedomain = DeconstructDomain(Domain=bnd)  # -> Start, End
division = Division(A=dedomain.End, B=multiplication_2)
divide = DivideCurve(Curve=crv_2, Count=division, Kinks=False)  # -> simplify(Points), Tangents, Parameters
branch_2 = TreeBranch(Tree=divide.Points, Path="{4}", MaintainPaths=True)
branch_3 = TreeBranch(Tree=divide.Points, Path="{3}", MaintainPaths=True)
branch_4 = TreeBranch(Tree=divide.Points, Path="{1}", MaintainPaths=True)
pline = PolyLine(Vertices=divide.Points, Closed=False)
crv_cp = CurveClosestPoint(Point=branch_3, Curve=move.Geometry)  # -> Point, Parameter, Distance
ln = Line(StartPoint=crv_cp.Point, EndPoint=branch_3)
curvepoint = PointOnCurve(ln, parameter=0.701)
quad_grid = CSharpScript(pts_UV=divide.Points)  # -> PTS; inputs pts_UV: tree of Point3d
# ---------- quad_grid: C# ----------
    DataTree <Point3d> pts = new DataTree <Point3d>();
    int count;
    int index = 0;

    int cnt = pts_UV.BranchCount;

    for(int i = 0; i < cnt - 1; i++){
      count = pts_UV.Branches[i].Count();

      for(int j = 0; j < count - 1; j++){
        GH_Path path = new GH_Path(index);

        Point3d pt0 = pts_UV.Branches[i][j];
        Point3d pt1 = pts_UV.Branches[i + 1][j];
        Point3d pt2 = pts_UV.Branches[i + 1][j + 1];
        Point3d pt3 = pts_UV.Branches[i][j + 1];

        pts.Add(pt0, path);
        pts.Add(pt1, path);
        pts.Add(pt2, path);
        pts.Add(pt3, path);

        index += 1;
      }
    }

      PTS = pts;
# ---------- end quad_grid ----------
tri_panels = CSharpScript(pts_UV=divide.Points)  # -> PTS; inputs pts_UV: tree of Point3d
# ---------- tri_panels: C# ----------
    DataTree <Point3d> vecs = new DataTree <Point3d>();
    DataTree <Point3d> pts = new DataTree <Point3d>();
    int count;
    int mod;
    int index = 0;

    int cnt = pts_UV.BranchCount;
    for(int i = 0; i < cnt; i++){
      GH_Path path = new GH_Path(i);
      count = pts_UV.Branches[i].Count();

      mod = count % 2;
      if(mod > 0){
        count -= 1;
      }

      for(int j = 0; j < count ;j++){
        if(i % 2 == 0 && j % 2 == 0){
          Rhino.Geometry.Point3d pt = pts_UV.Branches[i][j];
          vecs.Add(pt, path);
        } else if(i % 2 != 0 && j % 2 != 0 || j == 0 || j == count - 1 ){
          Rhino.Geometry.Point3d pt = pts_UV.Branches[i][j];
          vecs.Add(pt, path);
        }
      }
    }

    int cnt_i, cnt_j;
    index = 0;
    cnt_i = vecs.BranchCount - 1;

    for(int i = 0; i < cnt_i; i++){
      cnt_j = vecs.Branches[i].Count() - 1;
      for(int j = 0; j < cnt_j; j++){
        Rhino.Geometry.Point3d pt0;
        Rhino.Geometry.Point3d pt1;
        Rhino.Geometry.Point3d pt2;

        if(i % 2 == 0){
          GH_Path path_R = new GH_Path(index);
          pt0 = vecs.Branches[i][j + 1];
          pt1 = vecs.Branches[i][j];
          pt2 = vecs.Branches[i + 1][j + 1];
          pts.Add(pt0, path_R);
          pts.Add(pt1, path_R);
          pts.Add(pt2, path_R);
          index += 1;
          GH_Path path_L = new GH_Path(index);
          pt0 = vecs.Branches[i + 1][j];
          pt1 = vecs.Branches[i + 1][j + 1];
          pt2 = vecs.Branches[i][j];
          pts.Add(pt0, path_L);
          pts.Add(pt1, path_L);
          pts.Add(pt2, path_L);
          index += 1;
        } else {
          GH_Path path_R = new GH_Path(index);
          pt0 = vecs.Branches[i][j + 1];
          pt1 = vecs.Branches[i][j];
          pt2 = vecs.Branches[i + 1][j];
          pts.Add(pt0, path_R);
          pts.Add(pt1, path_R);
          pts.Add(pt2, path_R);
          index += 1;
          GH_Path path_L = new GH_Path(index);
          pt0 = vecs.Branches[i + 1][j];
          pt1 = vecs.Branches[i + 1][j + 1];
          pt2 = vecs.Branches[i][j + 1];
          pts.Add(pt0, path_L);
          pts.Add(pt1, path_L);
          pts.Add(pt2, path_L);
          index += 1;
        }
      }
    }

    PTS = pts;
# ---------- end tri_panels ----------
shift = ShiftList(List=branch_2, Shift=1, Wrap=True)
shift_2 = ShiftList(List=branch_4, Shift=1, Wrap=True)
flip = FlipMatrix(Data=divide.Points)
ln_2 = Line(StartPoint=branch_2, EndPoint=shift)
ln_3 = Line(StartPoint=branch_4, EndPoint=shift_2)
cluster = Cluster(L=ln_3)
cluster_2 = Cluster(L=ln_2)
ln_4 = Line(StartPoint=curvepoint, EndPoint=crv_cp.Point)
ln_5 = Line(StartPoint=curvepoint, EndPoint=branch_2)
ln_6 = Line(StartPoint=curvepoint, EndPoint=branch_4)
pline_2 = PolyLine(Vertices=flip, Closed=False)
quad_cell = CSharpScript(pts=quad_grid, depth=Slider(36, range=0..100), depth_fx=Slider(0.56, range=0..1), edge_offset=Slider(5, range=0..100))  # -> cell_boundary, cell_centroid, cell_plane, cell_depth; inputs pts: tree of Point3d, depth: Double, depth_fx: Double, edge_offset: Double
# ---------- quad_cell: C# ----------
    EDGE_OFFSET = edge_offset;

    DataTree <Curve> bounds = new DataTree <Curve>();
    DataTree <Plane> planes = new DataTree <Plane>();
    DataTree <Point3d> centroids = new DataTree <Point3d>();
    DataTree <Line> axes = new DataTree <Line>();

    int count = pts.BranchCount;

    for(int i = 0; i < count; i++){
      GH_Path path = new GH_Path(i);

      List<Point3d> pts_quad = pts.Branches[i];
      pts_quad = pts_planar(pts_quad);

      Polyline boundary = new Polyline(pts_quad);
      boundary.Add(boundary.PointAt(0));
      Point3d pt_Cen = boundary.CenterPoint();

      Point3d pt_0 = pts_quad[0];
      Point3d pt_1 = pts_quad[1];
      Point3d pt_2 = pts_quad[2];
      Point3d pt_3 = pts_quad[3];

      Curve quad_00 = cell_offset(pts_quad);
      bounds.Add(quad_00, path);

      /*
      double min_length = 1000000;

      Line e0 = new Line(pt_0, pt_1);
      Line e1 = new Line(pt_1, pt_2);
      Line e2 = new Line(pt_2, pt_3);
      Line e3 = new Line(pt_3, pt_0);

      if(e0.Length < min_length){
        min_length = e0.Length;
      }
      if(e1.Length < min_length){
        min_length = e1.Length;
      }
      if(e2.Length < min_length){
        min_length = e2.Length;
      }
      if(e3.Length < min_length){
        min_length = e3.Length;
      }
      if(depth > min_length){
        depth = min_length;
      }
      */

      Rhino.Geometry.Plane plane = new Rhino.Geometry.Plane(pt_0, pt_1, pt_2);
      Vector3d vec = plane.Normal;
      vec.Reverse();
      Point3d centroid = pt_Cen + (vec * (depth * depth_fx));
      plane.Origin = pt_Cen;

      /*
      List<Point3d> pts_00 = new List<Point3d>();
      List<Point3d> pts_01 = new List<Point3d>();
      List<Point3d> pts_02 = new List<Point3d>();

      pts_00.Add(centroid);
      pts_00.Add(pt_0);
      pts_00.Add(pt_1);

      pts_01.Add(centroid);
      pts_01.Add(pt_1);
      pts_01.Add(pt_2);

      pts_02.Add(centroid);
      pts_02.Add(pt_2);
      pts_02.Add(pt_0);

      Curve tri_0 = cell_offset(pts_00);
      Curve tri_1 = cell_offset(pts_01);
      Curve tri_2 = cell_offset(pts_02);

      bounds.Add(tri_0, path);
      bounds.Add(tri_1, path);
      bounds.Add(tri_2, path);
      planes.Add(plane, path);
      */

      Line axis = new Line(pt_Cen, centroid);
      centroids.Add(pt_Cen, path);
      axes.Add(axis, path);

    }

    cell_boundary = bounds;
    cell_centroid = centroids;
    cell_plane = planes;
    cell_depth = axes;
# ---------- quad_cell: C# additional code ----------
  double EDGE_OFFSET = 0;

  Rhino.Geometry.Curve cell_offset(List<Point3d> verts){
    double dist = -EDGE_OFFSET;
    Rhino.Geometry.Plane plane = new Rhino.Geometry.Plane(verts[0], verts[1], verts[2]);
    Rhino.Geometry.PolyCurve crv = new Rhino.Geometry.PolyCurve();

    //CONSTRUCT BOUNDARIES
    Line e_00 = new Rhino.Geometry.Line(verts[0], verts[1]);
    Line e_01 = new Rhino.Geometry.Line(verts[1], verts[2]);
    Line e_02 = new Rhino.Geometry.Line(verts[2], verts[3]);
    Line e_03 = new Rhino.Geometry.Line(verts[3], verts[0]);

    crv.Append(e_00);
    crv.Append(e_01);
    crv.Append(e_02);
    crv.Append(e_03);

    if(dist == 0){
      return crv;
    }else{
      Rhino.Geometry.Curve[] pline = crv.Offset(plane, dist, 0.01, CurveOffsetCornerStyle.Sharp);
      return pline[0];
    }
  }

  List<Point3d> pts_planar(List<Point3d> verts){
    Rhino.Geometry.Plane plane = new Rhino.Geometry.Plane(verts[0], verts[1], verts[2]);
    Point3d pt = plane.ClosestPoint(verts[3]);
    verts[3] = pt;

    return verts;
  }
  //
# ---------- end quad_cell ----------
dom = ConstructDomain(DomainStart=Slider(1, range=0..1), DomainEnd=Slider(0.25, range=0..1))
explode = Explode(Curve=pline_2, Recursive=True)  # -> flatten(Segments), Vertices
scale_fx = Slider(0.7119, range=0.25..1)
crv_3 = Curve(quad_cell.cell_boundary)
pt = Point(quad_cell.cell_centroid)
crv_4 = Curve(quad_cell.cell_depth)
merge = Merge(Data1=ln_4, Data2=ln_5, Data3=ln_6, Data4=explode.Segments, Data5=cluster_2, Data6=cluster)  # -> flatten(Result)
end = EndPoints(Curve=merge)  # -> Start, End
crv_cp_2 = CurveClosestPoint(Point=end.End, Curve=move.Geometry)  # -> Point, Parameter, Distance
bnd_2 = Bounds(Numbers=merge)
bnd_3 = Bounds(Numbers=crv_cp_2.Distance)
dedomain_2 = DeconstructDomain(Domain=bnd_2)  # -> Start, End
brep = Brep(crv_3)
cp = ControlPoints(Curve=crv_3)  # -> Points, Weights, Knots
remap = RemapNumbers(Value=crv_cp_2.Distance, Source=bnd_3, Target=dom)  # -> Mapped, Clipped
number_slider_2 = Slider(9, range=0..100)
division_2 = Division(A=dedomain_2.End, B=12)
split = SplitList(List=cp.Points, Index=4)  # -> simplify(ListA), ListB
quad_cell_2 = CSharpScript(
    pts=split.ListA,
    depth=Slider(1.5, range=0.05..2),
    depth_fx=Slider(0.483, range=0.1..1),
    scale_fx=scale_fx,
    edge_offset=Slider(1, range=0..1),
    e_max=Slider(1.46, range=0..5))  # -> cell_boundary, cell_centroid, cell_plane, cell_depth; inputs pts: tree of Point3d, depth: Double, depth_fx: Double, scale_fx: Double, edge_offset: Double, e_max: Double
# ---------- quad_cell_2: C# ----------
    EDGE_OFFSET = edge_offset;

    DataTree <Curve> bounds = new DataTree <Curve>();
    DataTree <Plane> planes = new DataTree <Plane>();
    DataTree <Point3d> centroids = new DataTree <Point3d>();
    DataTree <Line> axes = new DataTree <Line>();

    int count = pts.BranchCount;

    for(int i = 0; i < count; i++){
      GH_Path path = new GH_Path(i);

      List<Point3d> pts_quad = pts.Branches[i];
      //pts_quad = pts_planar(pts_quad);

      Polyline boundary = new Polyline(pts_quad);
      boundary.Add(boundary.PointAt(0));
      Point3d pt_Cen = boundary.CenterPoint();

      Point3d pt_0 = pts_quad[0];
      Point3d pt_1 = pts_quad[1];
      Point3d pt_2 = pts_quad[2];
      Point3d pt_3 = pts_quad[3];

      //Curve quad_00 = cell_offset(pts_quad);
      //bounds.Add(quad_00, path);

      double min_length = 1000000;
      double max_length = 0;

      Line e0 = new Line(pt_0, pt_1);
      Line e1 = new Line(pt_1, pt_2);
      Line e2 = new Line(pt_2, pt_3);
      Line e3 = new Line(pt_3, pt_0);

      if(e0.Length < min_length){
        min_length = e0.Length;
      }
      if(e1.Length < min_length){
        min_length = e1.Length;
      }
      if(e2.Length < min_length){
        min_length = e2.Length;
      }
      if(e3.Length < min_length){
        min_length = e3.Length;
      }


      if(e0.Length > max_length){
        max_length = e0.Length;
      }
      if(e1.Length > max_length){
        max_length = e1.Length;
      }
      if(e2.Length > max_length){
        max_length = e2.Length;
      }
      if(e3.Length > max_length){
        max_length = e3.Length;
      }

      if(depth > max_length){
        depth = max_length;
      }


      Rhino.Geometry.Plane plane = new Rhino.Geometry.Plane(pt_0, pt_1, pt_2);
      Vector3d vec = plane.Normal;
      vec.Reverse();
      plane.Origin = pt_Cen;

      Point3d pt_4 = pt_0 + (vec * (-depth * depth_fx));
      Point3d pt_5 = pt_0 + (vec * (depth));

      Vector3d vec_B = pt_5 - pt_2;
      //vec_B.Reverse();
      pt_5 = pt_2 + (vec_B * (scale_fx));

      List<Point3d> pts_00 = new List<Point3d>();
      List<Point3d> pts_01 = new List<Point3d>();
      List<Point3d> pts_02 = new List<Point3d>();
      List<Point3d> pts_03 = new List<Point3d>();

      pts_00.Add(pt_4);
      pts_00.Add(pt_0);
      pts_00.Add(pt_1);

      pts_01.Add(pt_5);
      pts_01.Add(pt_1);
      pts_01.Add(pt_2);

      pts_02.Add(pt_5);
      pts_02.Add(pt_2);
      pts_02.Add(pt_3);

      pts_03.Add(pt_4);
      pts_03.Add(pt_3);
      pts_03.Add(pt_0);

      Curve quad_0 = cell_offset(pts_00);
      Curve quad_1 = cell_offset(pts_01);
      Curve quad_2 = cell_offset(pts_02);
      Curve quad_3 = cell_offset(pts_03);

      if(e2.Length > e_max){
        bounds.Add(quad_0, path);
        bounds.Add(quad_1, path);
        bounds.Add(quad_2, path);
        bounds.Add(quad_3, path);
        planes.Add(plane, path);
      }
      //Line axis = new Line(pt_Cen, centroid);
      //axes.Add(axis, path);
      //centroids.Add(pt_Cen, path);

    }

    cell_boundary = bounds;
    cell_centroid = centroids;
    cell_plane = planes;
    cell_depth = axes;
# ---------- quad_cell_2: C# additional code ----------
  double EDGE_OFFSET = 0;

  Rhino.Geometry.Curve cell_offset(List<Point3d> verts){
    double dist = -EDGE_OFFSET;
    Rhino.Geometry.Plane plane = new Rhino.Geometry.Plane(verts[0], verts[1], verts[2]);
    Rhino.Geometry.PolyCurve crv = new Rhino.Geometry.PolyCurve();

    //CONSTRUCT BOUNDARIES
    Line e_00 = new Rhino.Geometry.Line(verts[0], verts[1]);
    Line e_01 = new Rhino.Geometry.Line(verts[1], verts[2]);
    Line e_02 = new Rhino.Geometry.Line(verts[2], verts[0]);
    //Line e_03 = new Rhino.Geometry.Line(verts[3], verts[0]);

    crv.Append(e_00);
    crv.Append(e_01);
    crv.Append(e_02);
    //crv.Append(e_03);
    /*
    if(dist == 0){
    return crv;
    }else{
    Rhino.Geometry.Curve[] pline = crv.Offset(plane, dist, 0.01, CurveOffsetCornerStyle.Sharp);
    return pline[0];
    }
    */
    return crv;
  }

  List<Point3d> pts_planar(List<Point3d> verts){
    Rhino.Geometry.Plane plane = new Rhino.Geometry.Plane(verts[0], verts[1], verts[2]);
    Point3d pt = plane.ClosestPoint(verts[3]);
    verts[3] = pt;

    return verts;
  }
  //
# ---------- end quad_cell_2 ----------
panel = Panel(division_2)
len_2 = Length(Curve=merge)
division_3 = Division(A=len_2, B=Slider(24, range=0..100))
Z = UnitZ(Factor=1)
pframe = PerpFrame(Curve=merge, Parameter="0.0")
multiplication_3 = Multiplication(A=remap.Mapped, B=division_3)
neg = Negative(Value=number_slider_2)
align = AlignPlanes(Planes=pframe)
align_2 = AlignPlane(Plane=pframe, Direction=Z)  # -> Plane_00, Angle
dom_2 = ConstructDomain(DomainStart=neg, DomainEnd=number_slider_2)
crv_5 = Curve(quad_cell_2.cell_boundary)
brep_2 = Brep(crv_5)
multiplication_4 = Multiplication(A=multiplication_3, B=0.5)
neg_2 = Negative(Value=multiplication_4)
dom_3 = ConstructDomain(DomainStart=neg_2, DomainEnd=multiplication_4)
end_2 = EndPoints(Curve=merge)  # -> Start, End
rectangle = Rectangle(Plane=align_2.Plane_00, XSize=dom_2, YSize=dom_3, Radius=0)  # -> Beam_sect_crv, Length
vec2pt = Vector2Pt(PointA=end_2.Start, PointB=end_2.End, Unitize=False)  # -> Vector, Length
extr = Extrude(Base=rectangle.Beam_sect_crv, Direction=vec2pt.Vector)
panel_2 = Panel(rectangle.Beam_sect_crv)
cap = CapHoles(Brep=extr)
colour = ColourPicker(PickedColour=RGB(158, 125, 173))
colour_2 = ColourPicker(PickedColour=RGB(82, 172, 199))
colour_3 = ColourPicker(PickedColour=RGB(47, 83, 92))
beam_elem = Line(merge)
move_3 = Move(Geometry=align_2.Plane_00, Motion=vec2pt.Vector)  # -> Geometry, Transform
brep_frame = Brep(cap)
end_3 = EndPoints(Curve=pline_2)  # -> Pts_000, Pts_001
pts_fixed = Point(crv_cp.Point)
beam_sect_crv = ClusterOutput(rectangle.Beam_sect_crv)
beam_elem_2 = ClusterOutput(beam_elem)
brep_frame_2 = ClusterOutput(brep_frame)
pts_fixed_2 = ClusterOutput(pts_fixed)
plane_00 = ClusterOutput(align_2.Plane_00)
plane_01 = ClusterOutput(move_3.Geometry)
preview = CustomPreview(Geometry=brep_2, Shader=colour_3)
preview_2 = CustomPreview(Geometry=quad_cell_2.cell_boundary, Shader=colour_2)
preview_3 = CustomPreview(Geometry=brep_frame, Shader=colour)
pts_000 = ClusterOutput(end_3.Pts_000)
pts_001 = ClusterOutput(end_3.Pts_001)

# ==== cluster Cluster_6
multiplication = Multiplication(A=Slider(500, range=0..1000), B=12)
X = UnitX(Factor=1)
amp = Amplitude(Vector=X, Amplitude=multiplication)
crv = Curve(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)
srf = Surface(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)
move = Move(Geometry=crv, Motion=amp)  # -> Geometry, Transform
move_2 = Move(Geometry=srf, Motion=amp)  # -> Geometry, Transform
sdivide = DivideSurface(Surface=reparameterize(move_2.Geometry), UCount=Slider(1, range=0..50), VCount=Slider(5, range=0..50))  # -> Points, Normals, simplify(Parameters)
branch = TreeBranch(Tree=sdivide.Parameters, Path="{1}", MaintainPaths=True)
iso = IsoCurve(Surface=reparameterize(move_2.Geometry), UVPoint=branch)  # -> simplify(UIsocurve), simplify(VIsocurve)
number_slider = Slider(25, range=0..100)
crv_2 = Curve(iso.UIsocurve)
len = Length(Curve=crv_2)  # -> flatten(Length)
bnd = Bounds(Numbers=len)
multiplication_2 = Multiplication(A=Slider(10, range=0..100), B=12)
dedomain = DeconstructDomain(Domain=bnd)  # -> Start, End
division = Division(A=dedomain.End, B=multiplication_2)
divide = DivideCurve(Curve=crv_2, Count=division, Kinks=False)  # -> simplify(Points), Tangents, Parameters
branch_2 = TreeBranch(Tree=divide.Points, Path="{4}", MaintainPaths=True)
branch_3 = TreeBranch(Tree=divide.Points, Path="{3}", MaintainPaths=True)
branch_4 = TreeBranch(Tree=divide.Points, Path="{1}", MaintainPaths=True)
pline = PolyLine(Vertices=divide.Points, Closed=False)
crv_cp = CurveClosestPoint(Point=branch_3, Curve=move.Geometry)  # -> Point, Parameter, Distance
ln = Line(StartPoint=crv_cp.Point, EndPoint=branch_3)
curvepoint = PointOnCurve(ln, parameter=0.701)
quad_grid = CSharpScript(pts_UV=divide.Points)  # -> PTS; inputs pts_UV: tree of Point3d; same code as quad_grid
tri_panels = CSharpScript(pts_UV=divide.Points)  # -> PTS; inputs pts_UV: tree of Point3d; same code as tri_panels
shift = ShiftList(List=branch_2, Shift=1, Wrap=True)
shift_2 = ShiftList(List=branch_4, Shift=1, Wrap=True)
flip = FlipMatrix(Data=divide.Points)
ln_2 = Line(StartPoint=branch_2, EndPoint=shift)
ln_3 = Line(StartPoint=branch_4, EndPoint=shift_2)
cluster = Cluster(L=ln_3)
cluster_2 = Cluster(L=ln_2)
ln_4 = Line(StartPoint=curvepoint, EndPoint=crv_cp.Point)
ln_5 = Line(StartPoint=curvepoint, EndPoint=branch_2)
ln_6 = Line(StartPoint=curvepoint, EndPoint=branch_4)
pline_2 = PolyLine(Vertices=flip, Closed=False)
quad_cell = CSharpScript(pts=quad_grid, depth=Slider(36, range=0..100), depth_fx=Slider(0.56, range=0..1), edge_offset=Slider(5, range=0..100))  # -> cell_boundary, cell_centroid, cell_plane, cell_depth; inputs pts: tree of Point3d, depth: Double, depth_fx: Double, edge_offset: Double; same code as quad_cell
explode = Explode(Curve=pline_2, Recursive=True)  # -> flatten(Segments), Vertices
scale_fx = Slider(0.7119, range=0.25..1)
crv_3 = Curve(quad_cell.cell_boundary)
pt = Point(quad_cell.cell_centroid)
crv_4 = Curve(quad_cell.cell_depth)
brep = Brep(crv_3)
cp = ControlPoints(Curve=crv_3)  # -> Points, Weights, Knots
split = SplitList(List=cp.Points, Index=4)  # -> simplify(ListA), ListB
quad_cell_2 = CSharpScript(
    pts=split.ListA,
    depth=Slider(1.5, range=0.05..2),
    depth_fx=Slider(0.483, range=0.1..1),
    scale_fx=scale_fx,
    edge_offset=Slider(1, range=0..1),
    e_max=Slider(1.46, range=0..5))  # -> cell_boundary, cell_centroid, cell_plane, cell_depth; inputs pts: tree of Point3d, depth: Double, depth_fx: Double, scale_fx: Double, edge_offset: Double, e_max: Double; same code as quad_cell_2
crv_5 = Curve(quad_cell_2.cell_boundary)
number_slider_2 = Slider(24, range=0..100)
number_slider_3 = Slider(0.8, range=0..1)
number_slider_4 = Slider(1, range=0..1)
brep_2 = Brep(crv_5)
number_slider_5 = Slider(9, range=0..100)
number_slider_6 = Slider(30, range=0..100)
X_2 = UnitX(Factor=1)
cluster_3 = Cluster_4(beam_elem_line=ln_4, beam_dim=number_slider_5, dist_crv=move.Geometry, fx_min=number_slider_3, fx_max=number_slider_4)  # -> beam_elem_line_3, section_height
Z = UnitZ(Factor=1)
number_slider_7 = Slider(6, range=0..100)
cluster_4 = Cluster_5(
    beam_elem_line=cluster_2,
    dist_crv=move.Geometry,
    span_depth_ratio=number_slider_7,
    fx_min=number_slider_3,
    fx_max=number_slider_4)  # -> beam_elem_line_3, section_height
cluster_5 = Cluster_3(beam_elem_line=cluster_3.beam_elem_line_3, beam_width=number_slider_5, beam_height=number_slider_6, vec_align_plane=X_2)  # -> beam_brep_2, beam_elem_line_3, beam_sect_crv_2, beam_span_2, plane_00_2, plane_01_2
cluster_6 = Cluster_3(beam_elem_line=ln_5, beam_width=number_slider_5, beam_height=number_slider_6, vec_align_plane=X_2)  # -> beam_brep_2, beam_elem_line_3, beam_sect_crv_2, beam_span_2, plane_00_2, plane_01_2
cluster_7 = Cluster_3(beam_elem_line=ln_6, beam_width=number_slider_5, beam_height=number_slider_6, vec_align_plane=X_2)  # -> beam_brep_2, beam_elem_line_3, beam_sect_crv_2, beam_span_2, plane_00_2, plane_01_2
cluster_8 = Cluster_5(
    beam_elem_line=cluster,
    dist_crv=move.Geometry,
    span_depth_ratio=number_slider_7,
    fx_min=number_slider_3,
    fx_max=number_slider_4)  # -> beam_elem_line_3, section_height
cluster_9 = Cluster_3(beam_elem_line=explode.Segments, beam_width=number_slider_6, beam_height=number_slider_5, vec_align_plane=Z)  # -> beam_brep_2, beam_elem_line_3, beam_sect_crv_2, beam_span_2, plane_00_2, plane_01_2
deplane = DeconstructPlane(Plane=cluster_6.plane_01_2)  # -> Origin, XAxis, YAxis, ZAxis
deplane_2 = DeconstructPlane(Plane=cluster_7.plane_01_2)  # -> Origin, XAxis, YAxis, ZAxis
cluster_10 = Cluster_3(
    beam_elem_line=cluster_8.beam_elem_line_3,
    beam_width=cluster_8.section_height,
    beam_height=number_slider_6,
    vec_align_plane=deplane_2.ZAxis)  # -> beam_brep_2, beam_elem_line_3, beam_sect_crv_2, beam_span_2, plane_00_2, plane_01_2
cluster_11 = Cluster_3(
    beam_elem_line=cluster_4.beam_elem_line_3,
    beam_width=cluster_4.section_height,
    beam_height=number_slider_6,
    vec_align_plane=deplane.ZAxis)  # -> beam_brep_2, beam_elem_line_3, beam_sect_crv_2, beam_span_2, plane_00_2, plane_01_2
merge = Merge(
    Data1=flatten(cluster_10.beam_elem_line_3),
    Data2=flatten(cluster_11.beam_elem_line_3),
    Data3=flatten(cluster_5.beam_elem_line_3),
    Data4=flatten(cluster_6.beam_elem_line_3),
    Data5=flatten(cluster_7.beam_elem_line_3),
    Data6=flatten(cluster_9.beam_elem_line_3))  # -> flatten(Beam_elem_line)
merge_2 = Merge(
    Data1=flatten(cluster_10.beam_sect_crv_2),
    Data2=flatten(cluster_11.beam_sect_crv_2),
    Data3=flatten(cluster_5.beam_sect_crv_2),
    Data4=flatten(cluster_6.beam_sect_crv_2),
    Data5=flatten(cluster_7.beam_sect_crv_2),
    Data6=flatten(cluster_9.beam_sect_crv_2))  # -> flatten(Beam_sect_crv)
merge_3 = Merge(
    Data1=flatten(cluster_10.beam_span_2),
    Data2=flatten(cluster_11.beam_span_2),
    Data3=flatten(cluster_5.beam_span_2),
    Data4=flatten(cluster_6.beam_span_2),
    Data5=flatten(cluster_7.beam_span_2),
    Data6=flatten(cluster_9.beam_span_2))  # -> flatten(Beam_span)
merge_4 = Merge(
    Data1=flatten(cluster_10.beam_brep_2),
    Data2=flatten(cluster_11.beam_brep_2),
    Data3=flatten(cluster_5.beam_brep_2),
    Data4=flatten(cluster_6.beam_brep_2),
    Data5=flatten(cluster_7.beam_brep_2),
    Data6=flatten(cluster_9.beam_brep_2))  # -> flatten(Beam_brep)
merge_5 = Merge(
    Data1=flatten(cluster_10.plane_00_2),
    Data2=flatten(cluster_11.plane_00_2),
    Data3=flatten(cluster_5.plane_00_2),
    Data4=flatten(cluster_6.plane_00_2),
    Data5=flatten(cluster_7.plane_00_2),
    Data6=flatten(cluster_9.plane_00_2))  # -> flatten(Plane_00)
merge_6 = Merge(
    Data1=flatten(cluster_10.plane_01_2),
    Data2=flatten(cluster_11.plane_01_2),
    Data3=flatten(cluster_5.plane_01_2),
    Data4=flatten(cluster_6.plane_01_2),
    Data5=flatten(cluster_7.plane_01_2),
    Data6=flatten(cluster_9.plane_01_2))  # -> flatten(Plane_01)
end = EndPoints(Curve=pline_2)  # -> Pts_000, Pts_001
bnd_2 = Bounds(Numbers=merge_3)
dedomain_2 = DeconstructDomain(Domain=bnd_2)  # -> Start, End
beam_elem_line = ClusterOutput(merge)
beam_sect_crv = ClusterOutput(merge_2)
beam_span = ClusterOutput(merge_3)
beam_brep = ClusterOutput(merge_4)
plane_00 = ClusterOutput(merge_5)
plane_01 = ClusterOutput(merge_6)
pts_000 = ClusterOutput(end.Pts_000)
pts_001 = ClusterOutput(end.Pts_001)
division_2 = Division(A=dedomain_2.End, B=12)
panel = Panel(division_2)
colour = ColourPicker(PickedColour=RGB(158, 125, 173))
colour_2 = ColourPicker(PickedColour=RGB(82, 172, 199))
colour_3 = ColourPicker(PickedColour=RGB(47, 83, 92))
pts_fixed = Point(crv_cp.Point)
pts_fixed_2 = ClusterOutput(pts_fixed)
preview = CustomPreview(Geometry=quad_cell_2.cell_boundary, Shader=colour_2)
preview_2 = CustomPreview(Geometry=brep_2, Shader=colour_3)
preview_3 = CustomPreview(Shader=colour)

# ==== cluster Cluster
L = ClusterInput()
lng = ListLength(List=L)
subtraction = Subtraction(A=lng, B=1)
split = SplitList(List=L, Index=subtraction)  # -> ListA, ListB
line = Line(split.ListA)
line_2 = ClusterOutput(line)

# ==== cluster Cluster_3
beam_elem_line = ClusterInput()
beam_width = ClusterInput()
beam_height = ClusterInput()
vec_align_plane = ClusterInput()
beam_height_2 = Number(beam_height)
beam_width_2 = Number(beam_width)
beam_elem_line_2 = Line(beam_elem_line)
sec_domain = Sec_domain(beam_dim=beam_width_2)
sec_domain_2 = Sec_domain(beam_dim=beam_height_2)
pframe = PerpFrame(Curve=beam_elem_line_2, Parameter=0)
align = AlignPlane(Plane=pframe, Vec_align_plane=vec_align_plane)  # -> Plane_00, Angle
plane_00 = Plane(align.Plane_00)
end = EndPoints(Curve=beam_elem_line_2)  # -> Start, End
rectangle = Rectangle(Plane=plane_00, XSize=sec_domain, YSize=sec_domain_2, Radius=0)  # -> Beam_sect_crv, Length
vec2pt = Vector2Pt(PointA=end.Start, PointB=end.End, Unitize=False)  # -> Vector, Length
extr = Extrude(Base=rectangle.Beam_sect_crv, Direction=vec2pt.Vector)
move = Move(Geometry=plane_00, Motion=vec2pt.Vector)  # -> Geometry, Transform
cap = CapHoles(Brep=extr)
beam_sect_crv = Curve(rectangle.Beam_sect_crv)
beam_span = Number(rectangle.Length)
plane_01 = Plane(move.Geometry)
beam_brep = Brep(cap)
beam_elem_line_3 = ClusterOutput(beam_elem_line_2)
beam_sect_crv_2 = ClusterOutput(beam_sect_crv)
beam_brep_2 = ClusterOutput(beam_brep)
beam_span_2 = ClusterOutput(beam_span)
plane_00_2 = ClusterOutput(plane_00)
plane_01_2 = ClusterOutput(plane_01)

# ==== cluster Cluster_4
beam_dim = ClusterInput()
dist_crv = ClusterInput()
beam_elem_line = ClusterInput()
fx_min = ClusterInput()
fx_max = ClusterInput()
end = EndPoints(Beam_elem_line=beam_elem_line)  # -> Start, End
beam_dim_2 = Number(beam_dim)
dom = ConstructDomain(DomainStart=fx_max, DomainEnd=fx_min)
crv_cp = CurveClosestPoint(Point=end.End, Dist_crv=dist_crv)  # -> Point, Parameter, Distance
beam_elem_line_2 = Line(beam_elem_line)
bnd = Bounds(Numbers=crv_cp.Distance)
remap = RemapNumbers(Value=crv_cp.Distance, Source=bnd, Target=dom)  # -> Mapped, Clipped
len = Length(Beam_elem_line=beam_elem_line)
multiplication = Multiplication(A=remap.Mapped, B=beam_dim_2)
multiplication_2 = Multiplication(A=multiplication, B=0.5)
beam_elem_line_3 = ClusterOutput(beam_elem_line_2)
section_height = ClusterOutput(multiplication_2)

# ==== cluster Cluster_5
dist_crv = ClusterInput()
beam_elem_line = ClusterInput()
span_depth_ratio = ClusterInput()
fx_min = ClusterInput()
fx_max = ClusterInput()
end = EndPoints(Beam_elem_line=beam_elem_line)  # -> Start, End
dom = ConstructDomain(DomainStart=fx_max, DomainEnd=fx_min)
crv_cp = CurveClosestPoint(Point=end.End, Dist_crv=dist_crv)  # -> Point, Parameter, Distance
beam_elem_line_2 = Line(beam_elem_line)
bnd = Bounds(Numbers=crv_cp.Distance)
remap = RemapNumbers(Value=crv_cp.Distance, Source=bnd, Target=dom)  # -> Mapped, Clipped
len = Length(Beam_elem_line=beam_elem_line)
division = Division(A=len, SpanDepth_ratio=span_depth_ratio)
multiplication = Multiplication(A=remap.Mapped, B=division)
multiplication_2 = Multiplication(A=multiplication, B=0.5)
beam_elem_line_3 = ClusterOutput(beam_elem_line_2)
section_height = ClusterOutput(multiplication_2)

# ==== cluster Sec_domain
beam_dim = ClusterInput()
multiplication = Multiplication(Beam_dim=beam_dim, B=0.5)
neg = Negative(Value=multiplication)
dom = ConstructDomain(DomainStart=neg, DomainEnd=multiplication)
dim_domain = ClusterOutput(dom)
